# Dynamo graph families_GetCategoryFromFile.dyn (Dynamo 2.0.1.5055)

# group: Input
# note: For selection and whatnot

# group: Background
# note: For workflow

# group: Control
# note: For sliders and other options

# group: To Revit
# note: For changes made to Revit

# group: Annotation
# note: For notes and titles

# group: Info
# note: For general Information

# group: Other
# note: For general other needs

# group: Read a directory for RFAs
string = StringInput("C:\Users\johnpierson\Desktop\OfficeDynamoGraphs\familiesToAudit")  # graph input
fromPath = DirectoryObject(path=string)  # "Directory.FromPath"
code_block = CodeBlock { "*.rfa"; }
getDirectoryContents = FileSystem.GetDirectoryContents(directory=fromPath, searchString=code_block)
readText = FileSystem.ReadText(file=getDirectoryContents.files)

# group: This calculates the position of the category name
string_2 = StringInput("<category>")  # graph input
lastIndexOf = String.LastIndexOf(str=readText, searchFor=string_2)
string_3 = StringInput("</category>")  # graph input
lastIndexOf_2 = String.LastIndexOf(str=readText, searchFor=string_3)
sub = lastIndexOf_2 - lastIndexOf

substring = String.Substring(str=readText, startIndex=lastIndexOf, length=sub)

# group: Get the category name
code_block_2 = CodeBlock { "<term>"; "</term>"; }
split = String.Split(str=substring, separater0=code_block_2.out0, separater1=code_block_2.out1)
code_block_3 = CodeBlock { 1; }
getItemAtIndex = List.GetItemAtIndex(list=split@L2, index=code_block_3)

# group: combines the filename with the category name
code_block_4 = CodeBlock { false; }
fileName = FileSystem.FileName(path=getDirectoryContents.files, withExtension=code_block_4)
code_block_5 = CodeBlock(category=getItemAtIndex, fileName=fileName) { category + "__" +fileName; }
