# Dynamo graph families_GetCategoryFromFile.dyn (Dynamo 1.3.3.4651)

# group: Parallax Dynamo Template
# note: </Title>
# note: <Title>

# group: Input
# note: For selection and whatnot

# group: Background
# note: For workflow

# group: Control
# note: For sliders and other options

# group: To Revit
# note: For changes made to Revit

# group: Annotation
# note: For notes and titles

# group: Info
# note: For general Information

# group: Other
# note: For general other needs

# group: Read a directory for RFAs
string = StringInput("C:\Users\JohnPierson\Desktop\OfficeDynamoWorkflows\familiesToAudit")
fromPath = DirectoryObject(string)  # "Directory.FromPath"
code_block = CodeBlock { "*.rfa"; }
contents = Directory.Contents(fromPath, code_block)
readText = File.ReadText(contents)
